# Grasshopper definition Urban_planning.gh (Grasshopper 1.0.8)
# plug-ins: Human

curve = Curve(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)
curve_2 = Curve(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)
curve_3 = Curve(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)
curve_4 = Curve(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)

number_of_building_types = Slider(5, range=0..10)
minimum_area = Slider(30, range=0..100)
maximum_area = Slider(87, range=0..100)
entrance_width = Slider(4, range=0..10)
entrance_spacing = Slider(5, range=0..10)
road_width = Slider(5, range=0..10)
curve_5 = Curve(curve_3)
number_of_building_types_2 = GetInteger(number_of_building_types, AtLeast=1, AtMost=1, Maximum=2147483647, Minimum=-2147483648, TreeAccess=False)
minimum_area_2 = GetInteger(minimum_area, AtLeast=1, AtMost=1, Maximum=2147483647, Minimum=-2147483648, TreeAccess=False)
maximum_area_2 = GetInteger(maximum_area, AtLeast=1, AtMost=1, Maximum=2147483647, Minimum=-2147483648, TreeAccess=False)
entrance_width_2 = GetInteger(entrance_width, AtLeast=1, AtMost=1, Maximum=2147483647, Minimum=-2147483648, TreeAccess=False)
entrance_spacing_2 = GetInteger(entrance_spacing, AtLeast=1, AtMost=1, Maximum=2147483647, Minimum=-2147483648, TreeAccess=False)
road_width_2 = GetInteger(road_width, AtLeast=1, AtMost=1, Maximum=2147483647, Minimum=-2147483648, TreeAccess=False)
construct_domain = ConstructDomain(DomainStart=minimum_area_2, DomainEnd=maximum_area_2)
custom_preview_lineweights = CustomPreviewLineweights(Geometry=curve_5, Shader=ColourSwatch(SwatchColor=RGB(121, 128, 130)), Thickness=Slider(2, range=0..10), Absolute=True)
range = Range(Domain=construct_domain, Steps=number_of_building_types_2)
python_3_script = Python3Script(polyline=curve_5, num_units=number_of_building_types_2, unit_areas=range)  # -> out, a; inputs polyline: Polyline, num_units: Int32, unit_areas: list of Double
# ---------- python_3_script: Python ----------
import Rhino.Geometry as rg
import math
import random
from collections import defaultdict

clearance = 2

def generate_rectangles_from_areas(areas, aspect_ratio=1.5, base_plane=rg.Plane.WorldXY):
	rectangles = []
	dimensions = []
	
	for area in areas:
		width = math.sqrt(area / aspect_ratio)
		height = width * aspect_ratio
		dimensions.append((width, height))

		rect = rg.Rectangle3d(base_plane, width, height)
		rectangles.append(rect)

	return rectangles, dimensions

def get_max_length(dimensions):
    return max(max(w, h) for w, h in dimensions)

def generateCornerPolygonsx(plot, max_offset):
    segments = plot.GetSegments()  
    corner_points = []  
    moved_points = []   
    for i in range(len(segments)):
        seg1 = segments[i]
        seg2 = segments[(i + 1) % len(segments)] 
        corner_point = seg1.To  
        corner_points.append(corner_point)
        dir1 = seg1.Direction
        dir2 = seg2.Direction
        dir1.Unitize()
        dir2.Unitize()
        moved_p1 = corner_point - (dir1 * max_offset)  
        moved_p2 = corner_point + (dir2 * max_offset)  
        moved_points.append(moved_p1)
        moved_points.append(moved_p2)
    return corner_points, moved_points


rectangles, dims = generate_rectangles_from_areas(unit_areas)
max_offset = get_max_length(dims) + clearance

a = max_offset
# ---------- end python_3_script ----------
python_3_script_2 = Python3Script(polygon=curve_5, max_offset=python_3_script.a)  # -> out, a, b, c; inputs polygon: Polyline, max_offset: Double
# ---------- python_3_script_2: Python ----------
import Rhino.Geometry as rg
import math


class CornerPoint:
    def __init__(self, corner_point, moved_pt1, perp_moved_pt1, moved_pt2, perp_moved_pt2):
        self.CornerPoint = corner_point
        self.MovedPt1 = moved_pt1
        self.PerpMovedPt1 = perp_moved_pt1
        self.MovedPt2 = moved_pt2
        self.PerpMovedPt2 = perp_moved_pt2

    def __str__(self):
        return (
            f"CornerPoint: {self.CornerPoint}\n"
            f"MovedPt1: {self.MovedPt1}\n"
            f"PerpMovedPt1: {self.PerpMovedPt1}\n"
            f"MovedPt2: {self.MovedPt2}\n"
            f"PerpMovedPt2: {self.PerpMovedPt2}\n"
        )


def get_corner_and_moved_points(polygon, max_offset):
    corner_points = []
    moved_points = []
    remaining_segments = []

    for i in range(len(polygon)):
        pt_prev = polygon[(i - 1) % len(polygon)]
        pt_curr = polygon[i]
        pt_next = polygon[(i + 1) % len(polygon)]

        angle = measure_angle(pt_prev, pt_curr, pt_next)

        if angle > math.pi / 2:
            move_dist = max_offset
        else:
            move_dist = max_offset * 2

        prev_dir = pt_prev - pt_curr
        next_dir = pt_next - pt_curr

        prev_dir.Unitize()
        next_dir.Unitize()

        moved_pt1 = pt_curr + prev_dir * move_dist
        moved_pt2 = pt_curr + next_dir * move_dist

        corner_points.append(pt_curr)
        moved_points.append((moved_pt1, moved_pt2))

        if i > 0:
            remaining_segments.append(rg.Line(moved_points[i - 1][1], moved_pt1))

    remaining_segments.append(rg.Line(moved_points[-1][1], moved_points[0][0]))

    return corner_points, moved_points, remaining_segments


def measure_angle(pt1, pt2, pt3):
    vec1 = rg.Vector3d(pt1 - pt2)
    vec2 = rg.Vector3d(pt3 - pt2)
    angle = rg.Vector3d.VectorAngle(vec1, vec2)
    return angle


def create_perpendicular_lines(polygon, moved_points, max_offset):
    perp_lines = []

    for i in range(len(moved_points)):
        pt_curr = polygon[i]
        moved_pt1, moved_pt2 = moved_points[i]

        edge1_dir = moved_pt1 - pt_curr
        edge2_dir = moved_pt2 - pt_curr

        perp_dir1 = rg.Vector3d(-edge1_dir.Y, edge1_dir.X, 0)
        perp_dir2 = rg.Vector3d(-edge2_dir.Y, edge2_dir.X, 0)

        perp_dir1.Unitize()
        perp_dir2.Unitize()

        line1 = rg.Line(moved_pt1, moved_pt1 + perp_dir1 * max_offset)
        line2 = rg.Line(moved_pt1, moved_pt1 - perp_dir1 * max_offset)
        line3 = rg.Line(moved_pt2, moved_pt2 + perp_dir2 * max_offset)
        line4 = rg.Line(moved_pt2, moved_pt2 - perp_dir2 * max_offset)

        perp_lines.extend([line1, line2, line3, line4])

    return perp_lines


def create_corner_points(corner_points, moved_points, perp_lines):
    corner_objects = []

    for i in range(len(corner_points)):
        corner_point = corner_points[i]
        moved_pt1, moved_pt2 = moved_points[i]
        perp_moved_pt1 = perp_lines[i * 4].To
        perp_moved_pt2 = perp_lines[i * 4 + 3].To

        corner_obj = CornerPoint(corner_point, moved_pt1, perp_moved_pt1, moved_pt2, perp_moved_pt2)
        corner_objects.append(corner_obj)

    return corner_objects


def create_corner_polygons(corner_objects):
    corner_polygons = []

    for corner in corner_objects:
        polygon = rg.Polyline([
            corner.CornerPoint,
            corner.MovedPt1,
            corner.PerpMovedPt1,
            corner.PerpMovedPt2,
            corner.MovedPt2,
            corner.CornerPoint
        ])
        corner_polygons.append(polygon)

    return corner_polygons


def main(polygon, max_offset):
    corner_points, moved_points, remaining_segments = get_corner_and_moved_points(polygon, max_offset)
    perp_lines = create_perpendicular_lines(polygon, moved_points, max_offset)
    corner_objects = create_corner_points(corner_points, moved_points, perp_lines)
    corner_polygons = create_corner_polygons(corner_objects)
    return corner_objects, corner_polygons, remaining_segments


corner_objects, corner_polygons, remaining_segments = main(polygon, max_offset)

a = corner_objects
b = corner_polygons
c = remaining_segments

for i, corner in enumerate(corner_objects):
    print(f"Corner Object {i}:\n{corner}")

for i, segment in enumerate(remaining_segments):
    print(f"Remaining Segment {i}: Start {segment.From}, End {segment.To}")
# ---------- end python_3_script_2 ----------

curve_6 = Curve(python_3_script_2.b)
list_item = ListItem(List=curve_6, Index=0, Wrap=True)  # -> Item1, Item
deconstruct_brep = DeconstructBrep(Brep=list_item.Item)  # -> Faces, Edges, Vertices
deconstruct_brep_2 = DeconstructBrep(Brep=list_item.Item1)  # -> Faces, Edges, Vertices
point_order = PointOrder(Points=deconstruct_brep_2.Vertices)
cull_index = CullIndex(List=curve_6, Indices=[Slider(0, range=0..100), "-1"], Wrap=True)
point_order_2 = PointOrder(Points=deconstruct_brep.Vertices)
list_item_2 = ListItem(List=deconstruct_brep.Vertices, Index=0, Wrap=True)  # -> Item, Item1, Item2
list_item_3 = ListItem(List=deconstruct_brep_2.Vertices, Index=0, Wrap=True)  # -> Item, Item1, Item2
merge = Merge(
    Data1=list_item_3.Item,
    Data2=list_item_3.Item1,
    Data3=list_item_3.Item2,
    Data4=list_item_2.Item1,
    Data5=list_item_2.Item2)
polyline = PolyLine(Vertices=merge, Closed=True)
boundary_surfaces = BoundarySurfaces(Edges=[cull_index, polyline])
custom_preview = CustomPreview(Geometry=boundary_surfaces, Material=ColourSwatch(SwatchColor=RGB(18, 130, 1)))

unit_z = UnitZ(Factor=1)  # disabled

offset_curve = OffsetCurve(Curve=curve_5, Distance=expr("(x + 2) * -1", python_3_script.a), Corners=1)
merge_2 = Merge(Data1=cull_index, Data2=polyline)
region_difference = RegionDifference(CurvesA=offset_curve, CurvesB=merge_2)
offset_curve_2 = OffsetCurve(Curve=region_difference, Distance=expr("x * -1", road_width_2), Corners=1)
loft = Loft(
    Curves=flatten([offset_curve_2, region_difference]),
    Options={Adjust=False, Closed=False, LoftEnds=0, LoftSimp=0, LoftType=0, Rebuild=10, Refit=0.01})

curve_7 = Curve(offset_curve_2)  # disabled
python_3_script_3 = Python3Script(plot=curve_7, max_offset=python_3_script.a)  # -> out, a; inputs plot: Polyline; disabled
# ---------- python_3_script_3: Python ----------
import Rhino.Geometry as rg

def get_longest_segment(polyline):
    longest_segment = None
    max_length = 0
    
    for i in range(len(polyline) - 1):
        segment = rg.Line(polyline[i], polyline[i + 1])
        segment_length = segment.Length
        if segment_length > max_length:
            max_length = segment_length
            longest_segment = segment
    
    return longest_segment

a = get_longest_segment(plot)
# ---------- end python_3_script_3 ----------
offset_curve_3 = OffsetCurve(Curve=python_3_script_3.a, Distance=python_3_script.a, Corners=1)  # disabled
offset_curve_4 = OffsetCurve(Curve=offset_curve_3, Distance=python_3_script.a, Corners=1)  # disabled
extrude = Extrude(Base=offset_curve_3, Direction=unit_z)  # disabled
python_3_script_4 = Python3Script(segments=offset_curve_3, num_units=number_of_building_types_2, unit_areas=range)  # -> out, a, b; inputs segments: list of Curve, num_units: Int32, unit_areas: list of Double; disabled
# ---------- python_3_script_4: Python ----------
import Rhino.Geometry as rg
import math
import random


def calculate_unit_dimensions(areas, aspect_ratio=1.5):
    dimensions = []
    for area in areas:
        width = math.sqrt(area / aspect_ratio)
        height = width * aspect_ratio
        dimensions.append((width, height))
    return dimensions


def place_units_on_segments(segments, unit_areas):
    unit_dimensions = calculate_unit_dimensions(unit_areas)
    rectangles = []

    for segment in segments:
        if isinstance(segment, rg.Line):
            segment_length = segment.Length
            direction = segment.Direction
        elif isinstance(segment, rg.Curve) or isinstance(segment, rg.LineCurve):
            segment_length = segment.GetLength()
            direction = segment.TangentAtStart

        direction.Unitize()
        perp_vector = rg.Vector3d.CrossProduct(direction, rg.Vector3d.ZAxis)
        param = 0

        while param < segment_length:
            unit_width, unit_height = random.choice(unit_dimensions)

            if param + unit_width > segment_length:
                break

            position = segment.PointAt(segment.Domain.ParameterAt(param / segment_length))
            plane = rg.Plane(position, direction, perp_vector)
            rect = rg.Rectangle3d(plane, unit_width, unit_height)
            rectangles.append(rect)

            param += unit_width

    return rectangles



residential_units = place_units_on_segments(segments, unit_areas)

a = residential_units
# ---------- end python_3_script_4 ----------
offset_curve_5 = OffsetCurve(Curve=offset_curve_4, Distance=road_width_2, Corners=1)  # disabled
mirror = Mirror(Geometry=python_3_script_4.a, Plane=extrude)  # -> Geometry, Transform; disabled

python_3_script_5 = Python3Script(
    segments=python_3_script_2.c,
    num_units=number_of_building_types_2,
    unit_areas=range,
    entrance_width=entrance_width_2,
    entrance_spacing=entrance_spacing_2)  # -> out, a, b; inputs segments: list of Curve, num_units: Int32, unit_areas: list of Double, entrance_width: Int32, entrance_spacing: Int32
# ---------- python_3_script_5: Python ----------
import Rhino.Geometry as rg
import math
import random


def calculate_unit_dimensions(areas, aspect_ratio=1.5):
    dimensions = []
    for area in areas:
        width = math.sqrt(area / aspect_ratio)
        height = width * aspect_ratio
        dimensions.append((width, height))
    return dimensions


def place_units_on_segments(segments, unit_areas, entrance_spacing, entrance_width):
    unit_dimensions = calculate_unit_dimensions(unit_areas)
    rectangles = []
    entrance_lines = []

    for segment in segments:
        if isinstance(segment, rg.Line):
            segment_length = segment.Length
            direction = segment.Direction
        elif isinstance(segment, rg.Curve) or isinstance(segment, rg.LineCurve):
            segment_length = segment.GetLength()
            direction = segment.TangentAtStart

        direction.Unitize()
        perp_vector = rg.Vector3d.CrossProduct(direction, rg.Vector3d.ZAxis)
        param = 0
        units_placed = 0

        while param < segment_length:
            if units_placed >= entrance_spacing:
                remaining_length = segment_length - param
                if remaining_length < entrance_width:
                    entrance_width += remaining_length
                    break
                start_point = segment.PointAt(segment.Domain.ParameterAt(param / segment_length))
                end_point = segment.PointAt(segment.Domain.ParameterAt((param + entrance_width) / segment_length))
                entrance_lines.append(rg.Line(start_point, end_point))
                param += entrance_width
                units_placed = 0
                if param >= segment_length:
                    break

            unit_width, unit_height = random.choice(unit_dimensions)

            if param + unit_width > segment_length:
                break

            position = segment.PointAt(segment.Domain.ParameterAt(param / segment_length))
            plane = rg.Plane(position, direction, perp_vector)
            rect = rg.Rectangle3d(plane, unit_width, unit_height)
            rectangles.append(rect)

            param += unit_width
            units_placed += 1

    return rectangles, entrance_lines



residential_units, entrance_lines = place_units_on_segments(segments, unit_areas, entrance_spacing, entrance_width)

a = residential_units
b = entrance_lines
# ---------- end python_3_script_5 ----------
python_3_script_6 = Python3Script(num_colors=number_of_building_types_2)  # -> a; inputs num_colors: Int32
# ---------- python_3_script_6: Python ----------
import colorsys
import System.Drawing as sd
import random

def generate_colors(n):
    colors = set()  
    step = 1.0 / n  
    for i in range(n):
        hue = (i * step + 0.1) % 1.0  #
        saturation = 0.9  
        value = 0.9  
        rgb = colorsys.hsv_to_rgb(hue, saturation, value)
        color = sd.Color.FromArgb(int(rgb[0] * 255), int(rgb[1] * 255), int(rgb[2] * 255))
        if color not in colors:
            colors.add(color)
    return list(colors)

output_colors = generate_colors(num_colors + 1)

a = output_colors
# ---------- end python_3_script_6 ----------
python_3_script_7 = Python3Script(areas=range, res_units=[python_3_script_5.a, python_3_script_4.a, mirror.Geometry], colors=python_3_script_6)  # -> out, a, b; inputs areas: list of Double, res_units: list of Rectangle3d, colors: list of Color
# ---------- python_3_script_7: Python ----------
import Rhino.Geometry as rg

def get_rectangle3d_area(rect):
    return round(rect.Width * rect.Height, 2)

color_dictionary = {}
for i, j in zip(areas, colors):
    area_rounded = round(i, 2)
    color_dictionary[area_rounded] = j

rectangle_color_mapping = {}
missing_rectangles = []

for rect in res_units:
    area = get_rectangle3d_area(rect)
    closest_match = min(color_dictionary.keys(), key=lambda x: abs(x - area))

    if abs(closest_match - area) < 0.01: 
        rectangle_color_mapping[rect] = color_dictionary[closest_match]
    else:
        missing_rectangles.append(rect)

a = list(rectangle_color_mapping.keys())  
b = list(rectangle_color_mapping.values())
# ---------- end python_3_script_7 ----------
boundary_surfaces_2 = BoundarySurfaces(Edges=python_3_script_7.a)
custom_preview_2 = CustomPreview(Geometry=boundary_surfaces_2, Material=python_3_script_7.b)

curve_8 = Curve(python_3_script_5.b)
end_points = EndPoints(Curve=flatten(curve_8))  # -> Start, End
merge_3 = Merge(Data1=end_points.Start, Data2=end_points.End)
curve_closest_point = CurveClosestPoint(Point=merge_3, Curve=region_difference)  # -> flatten(Point), Parameter, Distance
line = Line(StartPoint=merge_3, EndPoint=curve_closest_point.Point)
list_length = ListLength(List=line)
division = Division(A=list_length, B=Slider(2, range=0..10))
partition_list = PartitionList(List=line, Size=division)
flip_matrix = FlipMatrix(Data=partition_list)
loft_2 = Loft(Curves=flip_matrix, Options={Adjust=False, Closed=False, LoftEnds=0, LoftSimp=0, LoftType=0, Rebuild=10, Refit=0.01})
brep = Brep([loft, loft_2])
green_areas = GetGeometry(
    boundary_surfaces,
    AnnotationTypeFilter=3966,
    AtLeast=1,
    AtMost=1,
    DeleteInput=False,
    Filter=1074081855,
    TreeAccess=False)
buildings = GetGeometry(
    boundary_surfaces_2,
    AnnotationTypeFilter=3966,
    AtLeast=1,
    AtMost=1,
    DeleteInput=False,
    Filter=1074081855,
    TreeAccess=False)
roads = GetGeometry(brep, AnnotationTypeFilter=3966, AtLeast=1, AtMost=1, DeleteInput=False, Filter=1074081855, TreeAccess=False)
custom_preview_3 = CustomPreview(Geometry=brep, Material=ColourSwatch(SwatchColor=RGB(204, 200, 200)))
